vi "DetermineHighScore.gvi"   [LabVIEW NXG 2.0.0]
inputs:
  "Current High Score": f64
  "New Score": f64
outputs:
  "New High Score": f64
diagram:
  Is Greater Or Equal To 0(x=$"New Score") -> w1
  case (w1) {
    frame True {
      Is Greater Or Equal To 0(x=$"Current High Score") -> w3
      case (w3) {
        frame True {
          Max And Min(x=$"Current High Score", y=$"New Score") -> (min(x,y)=w2: f64)
        }
        frame False {
          w2 = $"New Score"
        }
      }
    }
    frame False {
      w2 = $"Current High Score"
    }
  }
  $"New High Score" <- w2
