vi "ReflexTester.gviweb"   [LabVIEW NXG 2.0.0]
panel controls:
  "Power Button": bool
  "Tab": i32
panel indicators:
  "Score": f64
  "LED": bool
  "High Score": f64
  "Score History": f64
  "Power Button_2": bool
  "LED_2": bool
uses:
  WebVIArcade::ReflexTesterSubVIs::DetermineHighScore.gvi
diagram:
  s1 = "Prepare First Run"  # shift register
  while {
    case (s1) {
      frame "Prepare First Run" {
        $LED <- FALSE
        $"Power Button" <- FALSE
        $Score <- -1
        $"High Score" <- -1
        w1 = "Wait to Start"
      }
      frame "Wait to Start", Default {
        while {
          Wait(time to wait=0)
          stop if $"Power Button"
        }
        w1 = "Prepare Tester"
      }
      frame "Prepare Tester" {
        $LED <- FALSE
        $"Power Button" <- FALSE
        $Score <- 0
        w1 = "Run Tester"
      }
      frame "Run Tester" {
        Tick Count() -> (timer value=w2)
        Random Number() -> (number (0 to 1)=w3)
        Multiply(w3, 5000) -> w4
        while {
          Tick Count() -> (timer value=w5)
          Subtract(x=w5, y=w2) -> w6
          To Double Precision Float(number=w6) -> w7
          Is Greater(x=w7, y=w4) -> w8
          $LED <- w8
          Subtract(x=w7, y=w4) -> w9
          stop if $"Power Button"
        }
        call "DetermineHighScore.gvi"(Current High Score=$"High Score", New Score=w9) -> (New High Score=w10)
        $"High Score" <- w10
        $Score <- w9
        $"Score History" <- w9
        w1 = "Clean-up Tester"
      }
      frame "Clean-up Tester" {
        $"Power Button" <- FALSE
        $LED <- FALSE
        w1 = "Wait to Start"
      }
    }
    next s1 = w1
    stop if FALSE
  }
  while (iteration -> i1) {
    Wait(time to wait=500)
    Quotient And Remainder(x=i1, y=2) -> (x-y*floor(x/y)=w11)
    Is Equal To 0(x=w11) -> w12
    $LED_2 <- w12
    stop if FALSE
  }
