vi "Position Get.gvi"   [LabVIEW NXG 2.1.0]
inputs:
  "game state in": "Game State.gtype"
  "entity index": i32
outputs:
  "position": "Position.gtype"
types:
  "Direction.gtype" = enum{"⬆️", "↗️", "➡️", "↘️", "⬇️", "↙️", "⬅️", "↖️"}
  "Edible.gtype" = bool
  "Snake Body.gtype" = bool
  "Entity.gtype" = cluster{"Direction": "Direction.gtype"[], "Edible": "Edible.gtype"[], "Position": "Position.gtype"[], "Snake Body": "Snake Body.gtype"[], "Snake Head": "Snake Head.gtype"[]}
  "Game State.gtype" = cluster{"World Size": cluster{"Width": u32, "Height": u32}, "Entities": "Entity.gtype"[]}
  "Position.gtype" = cluster{"X": i32, "Y": i32}
uses:
  WebVIArcade::Snake::Entity Components::Entity Get.gvi
diagram:
  call "Entity Get.gvi"(game state in=$"game state in", enitity index=$"entity index") -> (entity=w1)
  Property Node(instance in=w1) -> ("Position"=w2)
  Array Index(array=w2) -> (out0[_]=w3)
  $position <- w3
