vi "Position Set.gvi"   [LabVIEW NXG 2.1.0]
inputs:
  "game state in": "Game State.gtype"
  "enitity index": i32
  "position": "Position.gtype"
outputs:
  "game state out": "Game State.gtype"
types:
  "Direction.gtype" = enum{"⬆️", "↗️", "➡️", "↘️", "⬇️", "↙️", "⬅️", "↖️"}
  "Edible.gtype" = bool
  "Snake Body.gtype" = bool
  "Entity.gtype" = cluster{"Direction": "Direction.gtype"[], "Edible": "Edible.gtype"[], "Position": "Position.gtype"[], "Snake Body": "Snake Body.gtype"[], "Snake Head": "Snake Head.gtype"[]}
  "Game State.gtype" = cluster{"World Size": cluster{"Width": u32, "Height": u32}, "Entities": "Entity.gtype"[]}
  "Position.gtype" = cluster{"X": i32, "Y": i32}
uses:
  WebVIArcade::Snake::Entity Components::Entity Get.gvi
  WebVIArcade::Snake::Entity Components::Entity Set.gvi
diagram:
  call "Entity Get.gvi"(game state in=$"game state in", enitity index=$"enitity index") -> (entity=w1)
  Property Node(instance in=w1) -> ("Position"=w2, instance out=w3)
  Replace Array Subset(inArray=w2, index=_, new=$position) -> w4
  Property Node(instance in=w3, "Position"=w4) -> (instance out=w5)
  call "Entity Set.gvi"(game state in=$"game state in", enitity index=$"enitity index", entity=w5) -> (game state out=w6)
  $"game state out" <- w6
