vi "Snake Head Set.gvi"   [LabVIEW NXG 2.1.0]
inputs:
  "game state in": "Game State.gtype"
  "snake head": "Snake Head.gtype"
  "enitity index": i32
outputs:
  "game state out": "Game State.gtype"
types:
  "Direction.gtype" = enum{"⬆️", "↗️", "➡️", "↘️", "⬇️", "↙️", "⬅️", "↖️"}
  "Edible.gtype" = bool
  "Snake Body.gtype" = bool
  "Entity.gtype" = cluster{"Direction": "Direction.gtype"[], "Edible": "Edible.gtype"[], "Position": "Position.gtype"[], "Snake Body": "Snake Body.gtype"[], "Snake Head": "Snake Head.gtype"[]}
  "Game State.gtype" = cluster{"World Size": cluster{"Width": u32, "Height": u32}, "Entities": "Entity.gtype"[]}
  "Snake Head.gtype" = cluster{"Snake Body Entities Index": i32[]}
uses:
  WebVIArcade::Snake::Entity Components::Entity Get.gvi
  WebVIArcade::Snake::Entity Components::Entity Set.gvi
diagram:
  call "Entity Get.gvi"(game state in=$"game state in", enitity index=$"enitity index") -> (entity=w1)
  Property Node(instance in=w1) -> ("Snake Head"=w2, instance out=w3)
  Replace Array Subset(inArray=w2, index=_, new=$"snake head") -> w4
  Property Node(instance in=w3, "Snake Head"=w4) -> (instance out=w5)
  call "Entity Set.gvi"(game state in=$"game state in", enitity index=$"enitity index", entity=w5) -> (game state out=w6)
  $"game state out" <- w6
