vi "Direction Get.gvi"   [LabVIEW NXG 2.1.0]
inputs:
  "game state in": "Game State.gtype"
  "entity index": i32
outputs:
  "direction": "Direction.gtype"
types:
  "Direction.gtype" = enum{"North", "Northeast", "East", "Southeast", "South", "Southwest", "West", "Northwest"}
  "Edible.gtype" = bool
  "Snake Body.gtype" = bool
  "Entity.gtype" = cluster{"Direction": "Direction.gtype"[], "Edible": "Edible.gtype"[], "Position": "Position.gtype"[], "Snake Body": "Snake Body.gtype"[], "Snake Head": "Snake Head.gtype"[]}
  "Game State.gtype" = cluster{"World Size": cluster{"Width": u32, "Height": u32}, "Entities": "Entity.gtype"[]}
diagram:
  Property Node(instance in=$"game state in") -> ("Entities"=w1)
  Array Index(array=w1) -> (out0[$"entity index"]=w2)
  Property Node(instance in=w2) -> ("Direction"=w3)
  Array Index(array=w3) -> (out0[_]=w4)
  $direction <- w4
