vi "Position Set.gvi"   [LabVIEW NXG 2.1.0]
inputs:
  "game state in": "Game State.gtype"
  "enitity index": i32
  "position": "Position.gtype"
outputs:
  "game state out": "Game State.gtype"
types:
  "Direction.gtype" = enum{"North", "Northeast", "East", "Southeast", "South", "Southwest", "West", "Northwest"}
  "Edible.gtype" = bool
  "Snake Body.gtype" = bool
  "Entity.gtype" = cluster{"Direction": "Direction.gtype"[], "Edible": "Edible.gtype"[], "Position": "Position.gtype"[], "Snake Body": "Snake Body.gtype"[], "Snake Head": "Snake Head.gtype"[]}
  "Game State.gtype" = cluster{"World Size": cluster{"Width": u32, "Height": u32}, "Entities": "Entity.gtype"[]}
  "Position.gtype" = cluster{"X": i32, "Y": i32}
diagram:
  Property Node(instance in=$"game state in") -> ("Entities"=w1, instance out=w2)
  Array Index(array=w1) -> (out0[$"enitity index"]=w3)
  Property Node(instance in=w3) -> ("Position"=w4, instance out=w5)
  Replace Array Subset(inArray=w4, index=_, new=$position) -> w6
  Property Node(instance in=w5, "Position"=w6) -> (instance out=w7)
  Replace Array Subset(inArray=w1, index=$"enitity index", new=w7) -> w8
  Property Node(instance in=w2, "Entities"=w8) -> (instance out=w9)
  $"game state out" <- w9
