vi "Grow Snake Body.gvi"   [LabVIEW NXG 2.1.0]
inputs:
  "game state in": "Game State.gtype"
  "number of body segments": i32
  "position": "Position.gtype"
outputs:
  "game state out": "Game State.gtype"
types:
  "Position.gtype" = cluster{"X": i32, "Y": i32}
  "Direction.gtype" = enum{"⬆️", "↗️", "➡️", "↘️", "⬇️", "↙️", "⬅️", "↖️"}
  "Edible.gtype" = bool
  "Snake Body.gtype" = bool
  "Entity.gtype" = cluster{"Direction": "Direction.gtype"[], "Edible": "Edible.gtype"[], "Position": "Position.gtype"[], "Snake Body": "Snake Body.gtype"[], "Snake Head": "Snake Head.gtype"[]}
  "Game State.gtype" = cluster{"World Size": cluster{"Width": u32, "Height": u32}, "Entities": "Entity.gtype"[]}
uses:
  WebVIArcade::Snake::SubVIs::Translate Position in Direction.gvi
  WebVIArcade::Snake::SubVIs::Snake Head Index.gvi
  WebVIArcade::Snake::Entity Components::Snake Head Get.gvi
  WebVIArcade::Snake::Entity Components::Snake Head Set.gvi
diagram:
  # TODO
  # update the snake head to have new body pieces appended
  Property Node(instance in=$"game state in") -> ("Entities"=w1)
  Array Size(array=w1) -> (size(s)=w2)
  s1 = $position  # shift register
  for (N = $"number of body segments") (iteration -> i1) {
    call "Translate Position in Direction.gvi"(position in=s1) -> (position out=w5)
    Build Array(w5) -> w6
    Property Node(instance in="Entity.gtype" {all zero or empty}, "Snake Body"=[TRUE], "Position"=w6) -> (instance out=w7)
    Add(w2, i1) -> w8
    append w7 to w3
    append w8 to w4
    next s1 = w5
  }
  Build Array[ConcatenateInputs=True](w1, w3) -> w9
  Property Node(instance in=$"game state in", "Entities"=w9) -> (instance out=w10)
  call "Snake Head Index.gvi"() -> (Index=w11)
  call "Snake Head Get.gvi"(game state in=w10, entity index=w11) -> (snake head=w12)
  Property Node(instance in=w12) -> ("Snake Body Entities Index"=w13, instance out=w14)
  Build Array[ConcatenateInputs=True](w13, w4) -> w15
  Property Node(instance in=w14, "Snake Body Entities Index"=w15) -> (instance out=w16)
  call "Snake Head Index.gvi"() -> (Index=w17)
  call "Snake Head Set.gvi"(game state in=w10, enitity index=w17, snake head=w16) -> (game state out=w18)
  $"game state out" <- w18
