vi "Initialize.gvi"   [LabVIEW NXG 2.1.0]
outputs:
  "game state out": "Game State.gtype"
types:
  "Direction.gtype" = enum{"North", "Northeast", "East", "Southeast", "South", "Southwest", "West", "Northwest"}
  "Edible.gtype" = bool
  "Snake Body.gtype" = bool
  "Entity.gtype" = cluster{"Direction": "Direction.gtype"[], "Edible": "Edible.gtype"[], "Position": "Position.gtype"[], "Snake Body": "Snake Body.gtype"[], "Snake Head": "Snake Head.gtype"[]}
  "Game State.gtype" = cluster{"World Size": cluster{"Width": u32, "Height": u32}, "Entities": "Entity.gtype"[]}
  "Snake Head.gtype" = cluster{"Snake Body Entities Index": u32[]}
  "Position.gtype" = cluster{"X": i32, "Y": i32}
diagram:
  Random Number() -> (number (0 to 1)=w1)
  Multiply(w1, 8) -> w2
  Build Array(w2) -> w3
  # Create the Snake Head as first index
  Build Array("Snake Head.gtype" {all zero or empty}) -> w4
  Property Node(instance in="Position.gtype" {all zero or empty}, "X"=500, "Y"=500) -> (instance out=w5)
  Build Array(w5) -> w6
  Property Node(instance in="Entity.gtype" {all zero or empty}, "Snake Head"=w4, "Position"=w6, "Direction"=w3) -> (instance out=w7)
  Build Array(w7) -> w8
  Property Node(instance in="Game State.gtype" {all zero or empty}, "World Size:Width"=1000, "World Size:Height"=1000, "Entities"=w8) -> (instance out=w9)
  $"game state out" <- w9
