vi "Render System.gvi"   [LabVIEW NXG 2.1.0]
inputs:
  "game state in": "Game State.gtype"
outputs:
  "game state rendered": cluster{"X": i32[], "Y": i32[]}[]
types:
  "Direction.gtype" = enum{"⬆️", "↗️", "➡️", "↘️", "⬇️", "↙️", "⬅️", "↖️"}
  "Edible.gtype" = bool
  "Snake Body.gtype" = bool
  "Entity.gtype" = cluster{"Direction": "Direction.gtype"[], "Edible": "Edible.gtype"[], "Position": "Position.gtype"[], "Snake Body": "Snake Body.gtype"[], "Snake Head": "Snake Head.gtype"[]}
  "Game State.gtype" = cluster{"World Size": cluster{"Width": u32, "Height": u32}, "Entities": "Entity.gtype"[]}
uses:
  WebVIArcade::Snake::SubVIs::Game State::Snake Head Index.gvi
  WebVIArcade::Snake::SubVIs::Entity Components::Position Get.gvi
diagram:
  call "Snake Head Index.gvi"() -> (Index=w1)
  call "Position Get.gvi"(game state in=$"game state in", entity index=w1) -> (position=w2)
  Property Node(instance in=w2) -> ("X"=w3, "Y"=w4)
  Add(w3, 50) -> w5
  Build Array(w3, w5) -> w6
  Add(w4, 50) -> w7
  Build Array(w4, w7) -> w8
  Property Node(instance in=cluster{"X": i32[], "Y": i32[]} {all zero or empty}, "X"=w6, "Y"=w8) -> (instance out=w9)
  Build Array(w9) -> w10
  # Array of
  #   Cluster of
  #     Array of X nums
  #     Array of Y nums
  $"game state rendered" <- w10
