vi "Snake Move System.gvi"   [LabVIEW NXG 2.1.0]
inputs:
  "game state in": "Game State.gtype"
outputs:
  "game state out": "Game State.gtype"
types:
  "Direction.gtype" = enum{"North", "Northeast", "East", "Southeast", "South", "Southwest", "West", "Northwest"}
  "Edible.gtype" = bool
  "Snake Body.gtype" = bool
  "Entity.gtype" = cluster{"Direction": "Direction.gtype"[], "Edible": "Edible.gtype"[], "Position": "Position.gtype"[], "Snake Body": "Snake Body.gtype"[], "Snake Head": "Snake Head.gtype"[]}
  "Game State.gtype" = cluster{"World Size": cluster{"Width": u32, "Height": u32}, "Entities": "Entity.gtype"[]}
uses:
  WebVIArcade::Snake::SubVIs::Game State::Snake Head Index.gvi
  WebVIArcade::Snake::SubVIs::Entity Components::Position Get.gvi
  WebVIArcade::Snake::SubVIs::Entity Components::Direction Get.gvi
  WebVIArcade::Snake::SubVIs::Entity Components::Position Set.gvi
diagram:
  call "Snake Head Index.gvi"() -> (Index=w1)
  call "Position Get.gvi"(game state in=$"game state in", entity index=w1) -> (position=w2)
  Property Node(instance in=w2) -> ("X"=w3, "Y"=w4, instance out=w5)
  call "Direction Get.gvi"(game state in=$"game state in", entity index=w1) -> (direction=w6)
  case (w6) {
    frame "North" {
      w9 = 0  # dx
      w10 = 1  # dy
      w7 = w9
      w8 = w10
    }
    frame "Northeast" {
      w11 = 1  # dx
      w12 = 1  # dy
      w7 = w11
      w8 = w12
    }
    frame "East" {
      w13 = 1  # dx
      w14 = 0  # dy
      w7 = w13
      w8 = w14
    }
    frame "Southeast" {
      w15 = 1  # dx
      w16 = -1  # dy
      w7 = w15
      w8 = w16
    }
    frame "South" {
      w17 = 0  # dx
      w18 = -1  # dy
      w7 = w17
      w8 = w18
    }
    frame "Southwest" {
      w19 = -1  # dx
      w20 = -1  # dy
      w7 = w19
      w8 = w20
    }
    frame "West" {
      w21 = -1  # dx
      w22 = 0  # dy
      w7 = w21
      w8 = w22
    }
    frame "Northwest" {
      w23 = -1  # dx
      w24 = 1  # dy
      w7 = w23
      w8 = w24
    }
  }
  Add(w4, w8) -> w25
  Add(w3, w7) -> w26
  Property Node(instance in=w5, "X"=w26, "Y"=w25) -> (instance out=w27)
  call "Position Set.gvi"(game state in=$"game state in", enitity index=w1, position=w27) -> (game state out=w28)
  $"game state out" <- w28
